# Grasshopper definition CurrentWIP.gh (Grasshopper 1.0.7)

geometry_pipeline = GeometryPipeline(
    GroupByLayer=False,
    GroupByType=False,
    IncludeHidden=True,
    IncludeLocked=True,
    LayerFilter="Default",
    NameFilter="*",
    SublayerFiltering=True,
    TypeFilter=1073741848)
panel = Panel("""corr
corr
corr
brrm""")
roomsolid = HBRoomFromSolid(geo=flatten(geometry_pipeline), name=panel, conditioned=True)  # -> out, rooms; plug-in component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
# https://stackoverflow.com/questions/773/how-do-i-use-itertools-groupby
hb_face_attributes = HBFaceAttributes({"Display Name": "display_name", "Simulation Name (Identifier)": "identifier", "Boundary Condition": "boundary_condition", "Has Parent": "has_parent", "Parent": "parent", "Area": "area", "Perimeter": "perimeter", "Face Type": "type", "Aperture Is Operable": "is_operable", "Door Is Glass": "is_glass"}, selected="Boundary Condition")

# ----
# this may be required for proper
# floor geom creation?
# that issue remember
solveadj = HBSolveAdjacency(rooms=flatten(roomsolid.rooms), run=Toggle(True))  # -> out, adj_rooms; plug-in component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

# ----
# For multiple stories:
# 
# from ittertools import groupby
# 
# for room in _model:
#      groupby(room.story)
# 
# groups = [ ] # for each group in groups
# for group in groupby #orwhatever:
#      for room in group:
#             groups.append(room)
lablefaces = HBLabelFaces(hb_objs=flatten(solveadj.adj_rooms), attribute=hb_face_attributes)  # -> label_text, base_pts, labels, wire_frame; plug-in component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
setstory = HBSetStory(rooms=solveadj.adj_rooms, story="1")  # -> out, rooms; plug-in component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
model = HBModel(rooms=flatten(setstory.rooms))  # -> out, model; plug-in component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
ghpython_script = GhPythonScript(x=model.model)  # -> out, a; inputs x: list
# ---------- ghpython_script: Python ----------
__author__ = "TREVOR"
__version__ = "2021.05.26"

import rhinoscriptsyntax as rs

import ladybug_rhino.fromgeometry as lbfg

for room in x:
    #for face in room.faces:
    fcs = [face.geometry for face in room.faces]
    print(fcs)
# ---------- end ghpython_script ----------

# ----
# have one compo
# I/O before writer
# To pass floor params (like AHU)
# Into individual Floor Instances
ghpython_script_2 = GhPythonScript(model=model.model)  # -> out, a, b, c, d, e, f, g, floorInst
# ---------- ghpython_script_2: Python ----------
__author__ = "TREVOR"
__version__ = "2021.05.24"

ghenv.Component.Message = 'change in to\n_hbModel\nout to\neQuestModel_'

import rhinoscriptsyntax as rs
from imp import reload
from ladybug_rhino import fromgeometry as fg
import ghpythonlib.components as ghc

import eQbug
import eQbug.fileBldr
from eQbug.fileBldr import eQspace, eQfloor
reload(eQbug)
reload(eQbug.fileBldr)

roomslst = []
flrget= []
flrlst = []

    
for room in _model.rooms:
    roomslst.append(eQspace(room))
    flrget.append(room)

for rm in flrget:
    floors =[ srfc for srfc in rm.faces if str(srfc.type)=='Floor']
    flrlst.append(floors)
burt = []
brp = []
for flr in flrlst:
    for f in flr:
        burt.append(f.geometry)
        
for b in burt:
    brp.append(fg.from_face3d(b))
    
ttlFloor = ghc.BrepJoin(brp).breps
levelFloorBrep = ttlFloor



def _get_verts(obj):
        brp_edges = ghc.DeconstructBrep(obj).edges
        brp_perim = ghc.JoinCurves(brp_edges, True)
        brp_verts = ghc.ControlPoints(brp_perim).points
        brpC =  ghc.CullDuplicates(brp_verts, 0.0).points
        verts = [(point.X,point.Y) for point in brpC]
        
        return verts

a = _get_verts(levelFloorBrep)


### NEED TO ADD STORY SORT


roomsToFloor=[]
for room in _model.rooms:
    roomsToFloor.append(room)
b = eQfloor(roomsToFloor)
c = b.floor_faces
d = b.floor_verts
e = b.floor_poly_strs
f = b.floor_space_strs
g = b.floor_zone_strs
print(b.rooms)
print('facesOfFloors',b.floor_faces)
print('check on floorfaces:::', b.floor_verts)
print(b.level)
print(b.room_inp_poly)

floorInst_ = b
# ---------- end ghpython_script_2 ----------

panel_2 = Panel(ghpython_script_2.floorInst)
panel_3 = Panel(ghpython_script_2.f)
panel_4 = Panel(ghpython_script_2.g)
panel_5 = Panel(ghpython_script_2.e)
panel_6 = Panel("D:\_BR+A\eQuestPython\eQRhGh\rhnoExmp\_newWIP\_fromRhinoINP")
ttlrp = Cordyceps_eQuestTitleRunPeriods(title="My_New_File")  # -> out, ttl
# ---------- ttlrp: Python ----------
"""
Use this component to set the Title, Run Periods, Design Days and Holidays for eQuest Simulation.
-
Provided by eQuest bug yet to be named

    Args:
        title: The Project name
        run_Period: The Run Period. The default is set to "entire Year".
        begin_Month: The default is set to 1.
        begin_Day: The default is set to 1.
        begin_Year: The default is set to 2021.
        end_Month: The default is set to 12.
        end_Day: The default is set to 31.
        end_Year: The default is set to 2021.
    Returns:
        ttlRpDdHd: The Title Run period design days and holidays block for *.inp.

"""
ghenv.Component.Name = "Cordyceps_eQuest Title, Run Periods"
ghenv.Component.NickName = 'ttlRP'
ghenv.Component.Message = 'VeR 0.0.1\nFeb_4_2021\nRunPeriodsAndTitleBlock'
ghenv.Component.Category = "bR+A energy"
ghenv.Component.SubCategory= 'Cordyceps_eQuest'
try: ghenv.Component.AdditionalHelpFromDocStrings = "0"
except: pass

import Grasshopper.Kernel as gh
w = gh.GH_RuntimeMessageLevel.Warning




def main(title, run_Period, begin_Month, begin_Day, begin_Year, end_Month, end_Day, end_Year):

    if title == None:
        warning = "Add Project Name or Number to the title input"
        ghenv.Component.AddRuntimeMessage(w, warning)
    if run_Period == None: run_Period = 'Entire Year'
    if begin_Month == None:begin_Month = '1'
    if begin_Day == None: begin_Day = '1'
    if begin_Year == None:begin_Year = '2021'
    if end_Month == None:end_Month = '12'
    if end_Day == None:end_Day = '31'
    if end_Year == None:end_Year = '2021'

    hdr = '$ '+'-'*57+'\n'+'$'+' '*14+'Title, Run Periods, Design Days, Holidays\n'+'$ '+'-'*57+'\n'

    ttb = 'TITLE\n   LINE-1          = {}\n   ..\n'.format(title)
    bprd = '"{}" = RUN-PERIOD-PD\n'.format(run_Period)+'   BEGIN-MONTH      = {}\n'.format(begin_Month)+'   BEGIN-DAY        = {}\n'.format(begin_Day)+'   BEGIN-YEAR       = {}\n'.format(begin_Year)
    #eprd = '   END-MONTH'+' '*6+'= {}\n'+'   END-DAY'+' '*8+'= {}\n'+'   END-YEAR'+' '*7+'= {}\n'+'   ..\n\n'.format(end_Month, end_Day, end_Year)
    eprd = '   END-MONTH        = {}\n   END-DAY          = {}\n   END-YEAR         = {}\n   ..\n\n'.format(end_Month, end_Day, end_Year)
    hds = '"Standad us Holidays" = HOLIDAYS'+'\n   LIBRARY-ENTRY "US\n   ..'

    return str(hdr+ttb+bprd+eprd+hds)

ttlRpDdHd = main(_title, _run_Period, _begin_Month, _begin_Day, _begin_Year, _end_Month, _end_Day, _end_Year)

ttl_ = ttlRpDdHd
# ---------- end ttlrp ----------
panel_7 = Panel(ttlrp.ttl)
ghpython_script_3 = GhPythonScript(ttl=ttlrp.ttl, floorInst=ghpython_script_2.floorInst, fileName="fromRhinoINP", filePath=panel_6)  # -> out, inp_file; inputs floorInst: list
# ---------- ghpython_script_3: Python ----------
__author__ = "TREVOR"
__version__ = "2021.05.26"

ghenv.Component.Message = 'The Writer'

import rhinoscriptsyntax as rs
from imp import reload
from ladybug_rhino import fromgeometry as fg
import ghpythonlib.components as ghc

import os

import eQbug
import eQbug.fileBldr
from eQbug.fileBldr import *
import eQbug.fileWriter
from eQbug.fileWriter import InpFile
reload(eQbug)
reload(eQbug.fileBldr)
reload(eQbug.fileWriter)


test = InpFile(_ttl, _floorInst)



target = _filePath+_fileName+'.inp'

asd = test.floor_inp_poly

print(asd)

inp_file_ = asd
# ---------- end ghpython_script_3 ----------
ghpython_script_4 = GhPythonScript()  # -> out, a; inputs Rooms: list
# ---------- ghpython_script_4: Python ----------
__author__ = "TREVOR"
__version__ = "2021.04.08"



ghenv.Component.Message = "Working Progress\n_rooms->Floor"


import rhinoscriptsyntax as rs

try:  # import the core honeybee dependencies
    from honeybee.room import Room
    from honeybee.facetype import get_type_from_normal
    from honeybee.typing import clean_and_id_string
except ImportError as e:
    raise ImportError('\nFailed to import honeybee:\n\t{}'.format(e))

try:  # import the ladybug_rhino dependencies
    from ladybug_rhino.config import tolerance, angle_tolerance
    from ladybug_rhino.togeometry import to_polyface3d
    from ladybug_rhino.grasshopper import all_required_inputs, give_warning, \
        document_counter, longest_list
except ImportError as e:
    raise ImportError('\nFailed to import ladybug_rhino:\n\t{}'.format(e))

try:  # import the honeybee-energy extension
    from honeybee_energy.lib.programtypes import program_type_by_identifier, office_program
    from honeybee_energy.lib.constructionsets import construction_set_by_identifier
except ImportError as e:
    if len(_program_) != 0:
        raise ValueError('_program_ has been specified but honeybee-energy '
                         'has failed to import.\n{}'.format(e))
    elif len(_constr_set_) != 0:
        raise ValueError('_constr_set_ has been specified but honeybee-energy '
                         'has failed to import.\n{}'.format(e))
    elif len(conditioned_) != 0:
        raise ValueError('conditioned_ has been specified but honeybee-energy '
                         'has failed to import.\n{}'.format(e))

try:  # import the honeybee-radiance extension
    from honeybee_radiance.lib.modifiersets import modifier_set_by_identifier
except ImportError as e:
    if len(_mod_set_) != 0:
        raise ValueError('_mod_set_ has been specified but honeybee-radiance '
                         'has failed to import.\n{}'.format(e))







lst=[]
for i, room in enumerate( _Rooms):
    
    try:
        fcl = [face for face in enumerate(room.faces)]
        dd = fcl[-2]
        lst.append(dd)
    except  IndexError:
        raise IndexError('No faces found on room:"{obj.name}"')
    
    
    
    a = str(lst)
    print(a)
    print(type(a))
# ---------- end ghpython_script_4 ----------
ghpython_script_5 = GhPythonScript()  # -> out, a; inputs rooms: list
# ---------- ghpython_script_5: Python ----------
__author__ = "TREVOR"
__version__ = "2021.04.08"

import rhinoscriptsyntax as rs

ghenv.Component.Message = 'Working Enum\nRoomsToGet\nFLOORSRFCS'

try:  # import the core honeybee dependencies
    from honeybee.room import Room
    from honeybee.facetype import get_type_from_normal
    from honeybee.typing import clean_and_id_string
except ImportError as e:
    raise ImportError('\nFailed to import honeybee:\n\t{}'.format(e))

try:  # import the ladybug_rhino dependencies
    from ladybug_rhino.config import tolerance, angle_tolerance
    from ladybug_rhino.togeometry import to_polyface3d
    from ladybug_rhino.grasshopper import all_required_inputs, give_warning, \
        document_counter, longest_list
except ImportError as e:
    raise ImportError('\nFailed to import ladybug_rhino:\n\t{}'.format(e))

try:  # import the honeybee-energy extension
    from honeybee_energy.lib.programtypes import program_type_by_identifier, office_program
    from honeybee_energy.lib.constructionsets import construction_set_by_identifier
except ImportError as e:
    if len(_program_) != 0:
        raise ValueError('_program_ has been specified but honeybee-energy '
                         'has failed to import.\n{}'.format(e))
    elif len(_constr_set_) != 0:
        raise ValueError('_constr_set_ has been specified but honeybee-energy '
                         'has failed to import.\n{}'.format(e))
    elif len(conditioned_) != 0:
        raise ValueError('conditioned_ has been specified but honeybee-energy '
                         'has failed to import.\n{}'.format(e))

try:  # import the honeybee-radiance extension
    from honeybee_radiance.lib.modifiersets import modifier_set_by_identifier
except ImportError as e:
    if len(_mod_set_) != 0:
        raise ValueError('_mod_set_ has been specified but honeybee-radiance '
                         'has failed to import.\n{}'.format(e))
                         
                         
                         
                         



flrslst = []
vrtslst = []
for room in _rooms:
    floors  =[ srfc for srfc in room.faces if str(srfc.type) == 'Floor']
    flrslst.append(floors)

print(str(flrslst))
a = str(flrslst)
# ---------- end ghpython_script_5 ----------
panel_8 = Panel(ghpython_script_4.a)
panel_9 = Panel(ghpython_script_3.inp_file)
panel_10 = Panel(ghpython_script_5.a)
ghpython_script_6 = GhPythonScript(rooms=setstory.rooms)  # -> out, a; inputs rooms: list
# ---------- ghpython_script_6: Python ----------
__author__ = "TREVOR"
__version__ = "2021.04.08"

import rhinoscriptsyntax as rs

ghenv.Component.Message = 'Working Enum\nRoomsToGet\nFLOORSRFCS'

try:  # import the core honeybee dependencies
    from honeybee.room import Room
    from honeybee.facetype import get_type_from_normal
    from honeybee.typing import clean_and_id_string
except ImportError as e:
    raise ImportError('\nFailed to import honeybee:\n\t{}'.format(e))

try:  # import the ladybug_rhino dependencies
    from ladybug_rhino.config import tolerance, angle_tolerance
    from ladybug_rhino.togeometry import to_polyface3d
    from ladybug_rhino.grasshopper import all_required_inputs, give_warning, \
        document_counter, longest_list
except ImportError as e:
    raise ImportError('\nFailed to import ladybug_rhino:\n\t{}'.format(e))

try:  # import the honeybee-energy extension
    from honeybee_energy.lib.programtypes import program_type_by_identifier, office_program
    from honeybee_energy.lib.constructionsets import construction_set_by_identifier
except ImportError as e:
    if len(_program_) != 0:
        raise ValueError('_program_ has been specified but honeybee-energy '
                         'has failed to import.\n{}'.format(e))
    elif len(_constr_set_) != 0:
        raise ValueError('_constr_set_ has been specified but honeybee-energy '
                         'has failed to import.\n{}'.format(e))
    elif len(conditioned_) != 0:
        raise ValueError('conditioned_ has been specified but honeybee-energy '
                         'has failed to import.\n{}'.format(e))

try:  # import the honeybee-radiance extension
    from honeybee_radiance.lib.modifiersets import modifier_set_by_identifier
except ImportError as e:
    if len(_mod_set_) != 0:
        raise ValueError('_mod_set_ has been specified but honeybee-radiance '
                         'has failed to import.\n{}'.format(e))

import ghpythonlib.components as ghc
import ladybug_geometry.bounding
from ladybug_geometry.bounding import bounding_box, bounding_box_extents
from ladybug_geometry.geometry3d.polyface import Polyface3D
from ladybug_geometry.geometry2d.polyline import Polyline2D as p2d
from ladybug_rhino import fromgeometry as fg




flrslst = []
vrtslst = []
for room in _rooms:
    floors  =[ srfc for srfc in room.faces if str(srfc.type) == 'Floor']
    flrslst.append(floors)
    for face in flrslst:
        for f in face:
            vt = f.vertices
            for v in vt:
                vs = (v.x, v.y)
                vrtslst.append(vs)

#print(str(flrslst))



burt = []
brp = []
for flr in flrslst:
    for f in flr:
        burt.append(f.geometry)
        
for b in burt:
    brp.append(fg.from_face3d(b))
    
ttlFloor = ghc.BrepJoin(brp).breps
balls = ttlFloor

def _get_verts(obj):
        brp_edges = ghc.DeconstructBrep(obj).edges
        brp_perim = ghc.JoinCurves(brp_edges, True)
        brp_verts = ghc.ControlPoints(brp_perim).points
        brpC =  ghc.CullDuplicates(brp_verts, 0.0).points
        verts = [(point.X,point.Y) for point in brpC]
        
        return verts

test = _get_verts(ttlFloor)
print(test)

a = test



#https://www.ladybug.tools/ladybug-rhino/docs/ladybug_rhino.fromgeometry.html
# ---------- end ghpython_script_6 ----------
panel_11 = Panel(ghpython_script_6.a)
ghpython_script_7 = GhPythonScript(rms=setstory.rooms)  # -> out, a, b, c, d, e
# ---------- ghpython_script_7: Python ----------
__author__ = "TREVOR"
__version__ = "2021.04.07"

import rhinoscriptsyntax as rs
from imp import reload

import eQbug
import eQbug.fileBldr
from eQbug.fileBldr import eQspace
reload(eQbug)
reload(eQbug.fileBldr)
try:  # import the core ladybug_rhino dependencies
    from ladybug_rhino.config import tolerance
    from ladybug_rhino.grasshopper import all_required_inputs
except ImportError as e:
    raise ImportError('\nFailed to import ladybug_rhino:\n\t{}'.format(e))

try:
    faces= [face for face in _rms.faces]
    a = faces[-2]
except IndexError:
    raise IndexError('No faces found on room:"{rms.name}')

vrtslst = [a.vertices]

#print(vrtslst)

tstSpc = eQspace(_rms)

#print(tstSpc.spc_vrts)

print(tstSpc.spcPlystr)

print(tstSpc.lvl)

b = tstSpc.spcPlystr

c = tstSpc.spcSpace

d = tstSpc.spcZone

e = tstSpc.floorSrfc
# ---------- end ghpython_script_7 ----------
panel_12 = Panel(ghpython_script_7.e)
poly = Panel(ghpython_script_7.b)
space = Panel(ghpython_script_7.c)
zone = Panel(ghpython_script_7.d)
